# Dynamo graph RevitDataQuery.dyn (Dynamo 0.7.5.3566)

select_model_elements = DSModelElementsSelection()  # 245 picked in the model
categories = Categories("StructuralFraming")
categories_2 = Categories("StructuralColumns")
create = List.Create(categories, categories_2)
code_block = CodeBlock { 1; }
flatten = List.Flatten(create, code_block)
all_elements_of_category = ElementsOfCategory(flatten)
watch = Watch(all_elements_of_category)
location = Custom[Element.Location](Element_s=all_elements_of_category)  # Returns the location of an element as an XYZ (or if it's line-based the start and end point of the line), along with some booleans to help filtering the results. Use this for some element types (e.g. walls or lines) that do not work with the built-in Get Family Instance Location node.
watch_2 = Watch(location.Curve_Endpoints)
ID = Custom[Element.ID](Element_s=all_elements_of_category)  # Gets the ID(s) for a list of Revit elements (or a single element) - unlike the built-in Element.Id node, this node returns an actual Revit Element ID and *not* a number
type = Custom[Element.Type](Element_s=all_elements_of_category)  # Gets the family type of a given element (if applicable).
boolean = BoolSelector(false)
materials = Custom[Element.Materials](Element_s=all_elements_of_category, Include_paint_materials=boolean)  # Retrieves all materials froma given element
properties = Custom[Material.Properties](Material_s=materials.Materials)  # Retrieves a number of properties froma given material
watch_3 = Watch(properties.Class)
level = Custom[Element.Level](element_s=all_elements_of_category)  # Gets an element's level
watch_4 = Watch(level)
python_script = Python(IN[0]=ID.ID_s, IN[1]=type, IN[2]=watch_3, IN[3]=watch_4)
# ---------- python_script.python (33 lines) ----------
import clr

clr.AddReference('ProtoGeometry')
from Autodesk.DesignScript.Geometry import *
#The inputs to this node will be stored as a list in the IN variable.
dataEnteringNode = IN

elementIds=IN[0]
familyTypes=IN[1]
materials=IN[2]
levels=IN[3]


data = []

for i in range (0,len(elementIds)-1):
	elementData="ElementId: " + elementIds[i].ToString()+ ","
	section=familyTypes[i].ToString().Split(":", ",")
	
	elementData+="Section: " + section [1] + ","
	elementData+="Material: "+ materials[i].ToString()+ ","
	elementData+="Level: "
	if(levels[i].ToString().Contains("List")):
		elementData+="No Level"
	else:
		elementData+=levels[i].ToString()
	
	
	data.append(elementData);
	

#Assign your output to the OUT variable
OUT = data
# ----------------------------------------
watch_5 = Watch(python_script)
file_path = Filename("C:\Users\Ana\Documents\GitHub\cardboard-java\RevitData.txt")
writeToFile = CSV.WriteToFile(file_path, python_script)
